% Simulink data dictionary robotDD.sldd

SensorData = Simulink.Bus()
  timeStamp: double, Unit="seconds"
  position1: double, Unit="degrees"
  position2: double, Unit="degrees"
  direction1: double, Unit="degrees"
  direction2: double, Unit="degrees"
  distance1: double, Unit="meters"
  distance2: double, Unit="meters"